# Dynamo graph Building Generator.dyn (Dynamo 2.0.2.6826)

XY = Plane.XY()
string = StringInput("L")
length = DoubleSlider(43000, range=0..100000 step 1000)
width = DoubleSlider(56000, range=0..100000 step 1000)
depth = DoubleSlider(8000, range=0..30000 step 1000)
total_floor_area = DoubleSlider(1000, range=0..1000 step 1)
code_block = CodeBlock(x=total_floor_area) { x*1000000; }
floor_height = DoubleSlider(11000, range=0..40000 step 1000)
boolean = BoolSelector(false)
buildingGenerator = Buildings.Creation.BuildingGenerator(BasePlane=XY, Type=string, Length=length, Width=width, Depth=depth, BldgArea=code_block, FloorHeight=floor_height, CreateCore=boolean)
angle_threshold = DoubleSlider(45, range=0..180 step 1)
deceonstructFacadeShell = Buildings.Analysis.DeceonstructFacadeShell(Mass=buildingGenerator.BuildingSolid, AngleThreshold=angle_threshold)
byJoinedSurfaces = PolySurface.ByJoinedSurfaces(surfaces=deceonstructFacadeShell.HorizontalSurfaces)
byJoinedSurfaces_2 = PolySurface.ByJoinedSurfaces(surfaces=deceonstructFacadeShell.VerticalSurfaces)
bySolid = PolySurface.BySolid(solid=buildingGenerator.BuildingSolid)
siteContext = Site.Analysis.SiteContext(RevitSite=bySolid)
toCuboid = BoundingBox.ToCuboid(boundingBox=siteContext.BoundingBoxes)
watch = Watch(siteContext.Heights)
code_block_2 = CodeBlock()
# ---------- code_block_2.designscript (6 lines) ----------
[
	Point.ByCoordinates(30000, 0),
	Point.ByCoordinates(0, 30000),
	Point.ByCoordinates(-30000, 0),
	Point.ByCoordinates(0, -18000)
];
# ----------------------------------------
boolean_2 = BoolSelector(true)
byPoints = PolyCurve.ByPoints(points=code_block_2, connectLastToFirst=boolean_2)
setback = DoubleSlider(3000, range=0..20000 step 1000)
max_height = DoubleSlider(40000, range=0..500000 step 1000)
siteMassGenerator = Site.Creation.SiteMassGenerator(SiteOutline=byPoints, Setback=setback, HeightLimit=max_height)
siteClashTest = Site.Analysis.SiteClashTest(BuildingMass=buildingGenerator.BuildingSolid, SiteMass=siteMassGenerator.SiteMass)
watch_2 = Watch(siteClashTest.DoesIntersect)
watch_3 = Watch(siteClashTest.BuildingOutside)
code_block_3 = CodeBlock { "Mass"; }
createRevitMass = Revit.ElementCreation.CreateRevitMass(FloorElevations=code_block_3)  # unwired: BuildingSolid
createRevitFloors = Revit.ElementCreation.CreateRevitFloors()  # unwired: Floors
